# Grasshopper definition monthly_wind_rose.gh (Grasshopper 1.0.7)

panel = Panel("F:\browserdownload\Chrome\CHN_Guangdong.Guangzhou.592870_CSWD\CHN_Guangdong.Guangzhou.592870_CSWD.epw")
importepw = LBImportEPW(epw_file=panel)  # -> location, dry_bulb_temperature, dew_point_temperature, relative_humidity, wind_speed, wind_direction, direct_normal_rad, diffuse_horizontal_rad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; plug-in component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
number_slider = Slider(32, range=0..50)
series = Series(Start=1, Step=1, Count=12)
analysisperiod = LBAnalysisPeriod(start_month=series, start_day=1, start_hour=0, end_month=series)  # -> period, hoys, dates; plug-in component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
rectangular = Rectangular(
    Plane=PlaneXY(0, 0, 0),
    SizeX=number_slider,
    SizeY=number_slider,
    ExtentX=Slider(3, range=0..10),
    ExtentY=Slider(2, range=0..10))  # -> Cells, Points
reverse_list = ReverseList(List=rectangular.Points)
flip_matrix = FlipMatrix(Data=reverse_list)  # -> flatten(Data)
windrose = LBWindRose(
    data=importepw.wind_speed,
    wind_direction=importepw.wind_direction,
    center_pt=flip_matrix,
    freq_dist=Slider(1, range=0..5),
    freq_hours=Slider(5, range=0..20),
    max_freq_lines=Slider(10, range=0..10),
    period=analysisperiod.period)  # -> out, mesh, compass, orient_line, freq_line, windrose_line, legend, title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; plug-in component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
panel_2 = Panel(windrose.prevailing)
